# Grasshopper definition last.gh (Grasshopper 1.0.7)

python = GhPythonScript(dip=Slider(80, range=0..100))  # -> pnt, a, p1, p2, p3, p4, p5, p6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
# ---------- python: Python ----------
import random
import rhinoscriptsyntax as rs

wid = 56
hig = 10
dip = 80

# 1. 배열과 직육면체 초기화
#grid = [[[0]*dip for _ in range(hig)] for _ in range(wid)]
grid = [[-1, 0, 0, 0, 0, 0, 0, 0, 0, 0], [-1, 0, 0, 0, 0, 0, 0, 0, 0, 0], [-1, 0, 0, 0, 0, 0, 0, 0, 0, 0], [-1, 0, 0, 0, 0, 0, 0, 0, 0, 0], [-1, 0, 0, 0, 0, 0, 0, 0, 0, 0], [-1, 0, 0, 0, 0, 0, 0, 0, 0, 0], [-1, 0, 0, 0, 0, 0, 0, 0, 0, 0], [-1, 0, 0, 0, 0, 0, 0, 0, 0, 0], [-1, 0, 0, 0, 0, 0, 0, 0, 0,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

for x in range(len(grid)):
    for y in range(len(grid[x])):
        grid[x][y] = [grid[x][y]]*dip
        

cubes = {1:[6, 6, 5, 1000, 0], 2:[6, 6, 10, 1000, 0],
         3:[8, 12, 5, 1000, 0], 4:[9, 11, 5, 1000, 0], 5:[10, 9, 5, 1000, 0],
         6:[7, 7, 10, 1000, 0], 7:[9, 7, 10, 1000, 0], 8:[9, 8, 10, 1000, 0],
         9:[12, 11, 5, 1000, 0], 10:[13, 13, 5, 1000, 0], 11:[13, 12, 5, 1000, 0],
        12:[9, 12, 10, 1000, 0], 13:[9, 9, 10, 1000, 0], 14:[8, 12, 10, 1000, 0],
         }
cube_centers = {key: [] for key in cubes.keys()}  # 직육면체의 중앙 좌표를 저장하는 사전


# 3. & 4. 배열에 직육면체 배치
x, y, z = 0, 0, 0
while z < dip:
    while y < hig:
        while x < wid:
            # 가능한 직육면체 탐색
            possible_cubes = []
            for key, (w, h, d, allocated, placed) in cubes.items():
                if placed < allocated and x + w <= wid and y + h <= hig and z + d <= dip:
                    # 추가된 부분: 해당 영역이 모두 0인지 확인
                    c = 1
                    for x1 in range(x, x+w):
                        for y1 in range(y, y+h):
                            for z1 in range(z, z+d):
                                if grid[x1][y1][z1]:
                                    c = 0
                                    break
                            if c == 0:
                                break
                    if c:
                        possible_cubes.append(key)
            if not possible_cubes:  # 가능한 직육면체가 없으면 다음 위치로 이동
                x += 1
                continue

            # 가능한 직육면체 중 하나 선택
            cube_key = random.choice(possible_cubes)
            w, h, d, _, _ = cubes[cube_key]

            # 선택한 직육면체를 배열에 배치
            for i in range(x, x+w):
                for j in range(y, y+h):
                    for k in range(z, z+d):
                        grid[i][j][k] = cube_key
            
            cubes[cube_key][4] += 1  # 배치 갯수 증가

            # 직육면체의 중앙 좌표를 저장
            center_x, center_y, center_z = x + w//2, y + h//2, z + d//2
            cube_centers[cube_key].append(rs.CreatePoint(center_x, center_y, center_z))

            # 현재 위치 갱신
            x += w
        x = 0
        y += 1
    z += 1
    x = 0
    y = 0

# 5. 결과 출력
#print(grid)
print(cubes)



p1 = cube_centers[1]
p2 = cube_centers[2]
p3 = cube_centers[3]
p4 = cube_centers[4]
p5 = cube_centers[5]
p6 = cube_centers[6]
p7 = cube_centers[7]
p8 = cube_centers[8]
p9 = cube_centers[9]
p10 = cube_centers[10]
p11 = cube_centers[11]
p12 = cube_centers[12]
p13 = cube_centers[13]
p14 = cube_centers[14]
# ---------- end python ----------

geo = Geometry([<brep referenced from the Rhino model> x5, <curve referenced from the Rhino model>, <brep referenced from the Rhino model>])
geo_2 = Geometry(<brep referenced from the Rhino model>)
area = Area(Geometry=geo_2)  # -> Area, Centroid
grp = Group(geo)
xy = XYPlane(Origin=area.Centroid)
orient = Orient(Geometry=graft(grp), Source=xy, Target=python.p3)  # -> Geometry, Transform
col = Colour("#BFBFFF")
preview = CustomPreview(Geometry=orient.Geometry, Material=col)

geo_3 = Geometry([<brep referenced from the Rhino model> x4, <curve referenced from the Rhino model>, <brep referenced from the Rhino model> x2])
geo_4 = Geometry(<brep referenced from the Rhino model>)
area_2 = Area(Geometry=geo_4)  # -> Area, Centroid
grp_2 = Group(geo_3)
xy_2 = XYPlane(Origin=area_2.Centroid)
orient_2 = Orient(Geometry=graft(grp_2), Source=xy_2, Target=python.p4)  # -> Geometry, Transform
col_2 = Colour("#7F7FFD")
preview_2 = CustomPreview(Geometry=orient_2.Geometry, Material=col_2)

geo_5 = Geometry([<brep referenced from the Rhino model> x5, <curve referenced from the Rhino model>, <brep referenced from the Rhino model>])
geo_6 = Geometry(<brep referenced from the Rhino model>)
area_3 = Area(Geometry=geo_6)  # -> Area, Centroid
grp_3 = Group(geo_5)
xy_3 = XYPlane(Origin=area_3.Centroid)
orient_3 = Orient(Geometry=graft(grp_3), Source=xy_3, Target=python.p5)  # -> Geometry, Transform
col_3 = Colour("#3F3FFF")
preview_3 = CustomPreview(Geometry=orient_3.Geometry, Material=col_3)

geo_7 = Geometry([<brep referenced from the Rhino model> x6])
geo_8 = Geometry(<brep referenced from the Rhino model>)
area_4 = Area(Geometry=geo_8)  # -> Area, Centroid
grp_4 = Group(geo_7)
xy_4 = XYPlane(Origin=area_4.Centroid)
orient_4 = Orient(Geometry=graft(grp_4), Source=xy_4, Target=python.p6)  # -> Geometry, Transform
col_4 = Colour("#0000FF")
preview_4 = CustomPreview(Geometry=orient_4.Geometry, Material=col_4)

geo_9 = Geometry([<brep referenced from the Rhino model> x4, <curve referenced from the Rhino model>, <brep referenced from the Rhino model> x2])
geo_10 = Geometry(<brep referenced from the Rhino model>)
area_5 = Area(Geometry=geo_10)  # -> Area, Centroid
grp_5 = Group(geo_9)
xy_5 = XYPlane(Origin=area_5.Centroid)
orient_5 = Orient(Geometry=graft(grp_5), Source=xy_5, Target=python.p7)  # -> Geometry, Transform
col_5 = Colour("#0000BF")
preview_5 = CustomPreview(Geometry=orient_5.Geometry, Material=col_5)

geo_11 = Geometry([<brep referenced from the Rhino model> x4, <curve referenced from the Rhino model>, <brep referenced from the Rhino model>, <curve referenced from the Rhino model>, <brep referenced from the Rhino model>])
geo_12 = Geometry(<brep referenced from the Rhino model>)
area_6 = Area(Geometry=geo_12)  # -> Area, Centroid
grp_6 = Group(geo_11)
xy_6 = XYPlane(Origin=area_6.Centroid)
orient_6 = Orient(Geometry=graft(grp_6), Source=xy_6, Target=python.p8)  # -> Geometry, Transform
col_6 = Colour("#00007F")
preview_6 = CustomPreview(Geometry=orient_6.Geometry, Material=col_6)

geo_13 = Geometry([<brep referenced from the Rhino model> x4])
geo_14 = Geometry(<brep referenced from the Rhino model>)
area_7 = Area(Geometry=geo_14)  # -> Area, Centroid
grp_7 = Group(geo_13)
xy_7 = XYPlane(Origin=area_7.Centroid)
orient_7 = Orient(Geometry=graft(grp_7), Source=xy_7, Target=python.p1)  # -> Geometry, Transform
col_7 = Colour("#97F7F7")
preview_7 = CustomPreview(Geometry=orient_7.Geometry, Material=col_7)

geo_15 = Geometry([<brep referenced from the Rhino model> x8])
geo_16 = Geometry(<brep referenced from the Rhino model>)
area_8 = Area(Geometry=geo_16)  # -> Area, Centroid
grp_8 = Group(geo_15)
xy_8 = XYPlane(Origin=area_8.Centroid)
orient_8 = Orient(Geometry=graft(grp_8), Source=xy_8, Target=python.p2)  # -> Geometry, Transform
col_8 = Colour("#12D7D7")
preview_8 = CustomPreview(Geometry=orient_8.Geometry, Material=col_8)

geo_17 = Geometry([<brep referenced from the Rhino model> x8, <curve referenced from the Rhino model>, <brep referenced from the Rhino model>])
geo_18 = Geometry(<brep referenced from the Rhino model>)
area_9 = Area(Geometry=geo_18)  # -> Area, Centroid
grp_9 = Group(geo_17)
xy_9 = XYPlane(Origin=area_9.Centroid)
orient_9 = Orient(Geometry=graft(grp_9), Source=xy_9, Target=python.p9)  # -> Geometry, Transform
col_9 = Colour("#A58CFF")
preview_9 = CustomPreview(Geometry=orient_9.Geometry, Material=col_9)

geo_19 = Geometry([<brep referenced from the Rhino model> x8, <curve referenced from the Rhino model>, <brep referenced from the Rhino model>])
geo_20 = Geometry(<brep referenced from the Rhino model>)
area_10 = Area(Geometry=geo_20)  # -> Area, Centroid
grp_10 = Group(geo_19)
xy_10 = XYPlane(Origin=area_10.Centroid)
orient_10 = Orient(Geometry=graft(grp_10), Source=xy_10, Target=python.p10)  # -> Geometry, Transform
col_10 = Colour("#9B64FF")
preview_10 = CustomPreview(Geometry=orient_10.Geometry, Material=col_10)

geo_21 = Geometry([<brep referenced from the Rhino model> x8, <curve referenced from the Rhino model>, <brep referenced from the Rhino model>])
geo_22 = Geometry(<brep referenced from the Rhino model>)
area_11 = Area(Geometry=geo_22)  # -> Area, Centroid
grp_11 = Group(geo_21)
xy_11 = XYPlane(Origin=area_11.Centroid)
orient_11 = Orient(Geometry=graft(grp_11), Source=xy_11, Target=python.p11)  # -> Geometry, Transform
col_11 = Colour("#9B30FF")
preview_11 = CustomPreview(Geometry=orient_11.Geometry, Material=col_11)

geo_23 = Geometry([<brep referenced from the Rhino model> x5, <curve referenced from the Rhino model> x2, <brep referenced from the Rhino model> x5])
geo_24 = Geometry(<brep referenced from the Rhino model>)
area_12 = Area(Geometry=geo_24)  # -> Area, Centroid
grp_12 = Group(geo_23)
xy_12 = XYPlane(Origin=area_12.Centroid)
orient_12 = Orient(Geometry=graft(grp_12), Source=xy_12, Target=python.p12)  # -> Geometry, Transform
col_12 = Colour("#912CEE")
preview_12 = CustomPreview(Geometry=orient_12.Geometry, Material=col_12)

geo_25 = Geometry([<brep referenced from the Rhino model> x4, <curve referenced from the Rhino model>, <brep referenced from the Rhino model> x6])
geo_26 = Geometry(<brep referenced from the Rhino model>)
area_13 = Area(Geometry=geo_26)  # -> Area, Centroid
grp_13 = Group(geo_25)
xy_13 = XYPlane(Origin=area_13.Centroid)
orient_13 = Orient(Geometry=graft(grp_13), Source=xy_13, Target=python.p13)  # -> Geometry, Transform
col_13 = Colour("#7D26CD")
preview_13 = CustomPreview(Geometry=orient_13.Geometry, Material=col_13)

geo_27 = Geometry([<brep referenced from the Rhino model> x4, <curve referenced from the Rhino model>, <brep referenced from the Rhino model> x6])
geo_28 = Geometry(<brep referenced from the Rhino model>)
area_14 = Area(Geometry=geo_28)  # -> Area, Centroid
grp_14 = Group(geo_27)
xy_14 = XYPlane(Origin=area_14.Centroid)
orient_14 = Orient(Geometry=graft(grp_14), Source=xy_14, Target=python.p14)  # -> Geometry, Transform
col_14 = Colour("#551A8B")
preview_14 = CustomPreview(Geometry=orient_14.Geometry, Material=col_14)
